# Grasshopper definition propeller_generator.ghx (Grasshopper 1.0.8)
# plug-ins: ShapeDiverForGrasshopper

# ----
# Inputs (JSON)
distance_to_middle_naca_times_radius = Slider(0.3, range=0.3..0.7)
radius_of_the_impeller = Slider(70, range=60..80)
thickness_of_the_outer_ring = Slider(5, range=1..5)
hight_of_the_impeller = Slider(10, range=4..10)
high_point_i_10ths_chord = Slider(4, range=2..8)
thickness_o_chord = Slider(24, range=3..24)
high_point_o_10ths_chord = Slider(2, range=2..8)
camber_o_chord = Slider(9, range=0..9)
chord_o_mm = Slider(29, range=10..30)
angle_o_degree = Slider(25, range=2..25)
thickness_i_chord = Slider(6, range=3..24)
camber_i_chord = Slider(4, range=0..9)
angle_m_degree = Slider(22, range=2..25)
angle_i_degree = Slider(25, range=2..25)
amount_of_blades = Slider(3, range=3..6)
chord_m_mm = Slider(20, range=10..30)
chord_i_mm = Slider(11, range=3..11)
inputjsonmaker = Python3Script(
    impellerRadius=radius_of_the_impeller,
    impellerHeight=hight_of_the_impeller,
    impellerThickness=thickness_of_the_outer_ring,
    bladeCount=amount_of_blades,
    innerThickness=thickness_i_chord,
    innerMaxPos=high_point_i_10ths_chord,
    innerCamber=camber_i_chord,
    innerChord=chord_i_mm,
    innerAngle=angle_i_degree,
    middlePos=distance_to_middle_naca_times_radius,
    middleChord=chord_m_mm,
    middleAngle=angle_m_degree,
    outerThickness=thickness_o_chord,
    outerMaxPos=high_point_o_10ths_chord,
    outerCamber=camber_o_chord,
    outerChord=chord_o_mm,
    outerAngle=angle_o_degree)  # -> out, inputJSON; inputs bladeCount: Int32
# ---------- inputjsonmaker: Python ----------
import json

# Create a dictionary with the parameters
data = {
    "impellerRadius": impellerRadius,
    "impellerHeight": impellerHeight,
    "impellerThickness": impellerThickness,
    "bladeCount": bladeCount,
    "innerThickness": innerThickness,
    "innerMaxPos": innerMaxPos,
    "innerCamber": innerCamber,
    "innerChord": innerChord,
    "innerAngle": innerAngle,
    "middlePos": middlePos,
    "middleChord": middleChord,
    "middleAngle": middleAngle,
    "outerThickness": outerThickness,
    "outerMaxPos": outerMaxPos,
    "outerCamber": outerCamber,
    "outerChord": outerChord,
    "outerAngle": outerAngle
}

inputJSON = json.dumps(data)
# ---------- end inputjsonmaker ----------
parsejson = ParseJSON(JSON=inputjsonmaker.inputJSON)
panel = Panel(parsejson)
inputjsoninterpreter = Python3Script(inputJSON=parsejson)  # -> out, impellerRadius, impellerHeight, impellerThickness, bladeCount, innerThickness, innerMaxPos, innerCamber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; inputs inputJSON: String
# ---------- inputjsoninterpreter: Python ----------
import json
    
data = json.loads(inputJSON)

impellerRadius  = data.get("impellerRadius")
impellerHeight  = data.get("impellerHeight")
impellerThickness = data.get("impellerThickness")
bladeCount = data.get("bladeCount")
innerThickness = data.get("innerThickness")
innerMaxPos = data.get("innerMaxPos")
innerCamber = data.get("innerCamber")
innerChord = data.get("innerChord")
innerAngle = data.get("innerAngle")
middlePos = data.get("middlePos")
middleChord = data.get("middleChord")
middleAngle = data.get("middleAngle")
outerThickness = data.get("outerThickness")
outerMaxPos = data.get("outerMaxPos")
outerCamber = data.get("outerCamber")
outerChord = data.get("outerChord")
outerAngle = data.get("outerAngle")
# ---------- end inputjsoninterpreter ----------

panel_2 = Panel("""{
  "impellerRadius": 75.0,
  "impellerHeight": 8.0,
  "impellerThickness": 2.5,
  "bladeCount": 4,
  "innerThickness": 8.0,
  "innerMaxPos": 3,
  "innerCamber": 3.0,
  "innerChord": 6.0,
  "innerAngle": 6.0,
  "middlePos": 0.5,
  "middleChord": 20.0,
  "middleAngle": 12.0,
  "outerThickness": 8.0,
  "outerMaxPos": 4,
  "outerCamber": 2.0,
  "outerChord": 26.0,
  "outerAngle": 18.0
}""")
panel_3 = Panel("""{
  "impellerRadius": 62,
  "impellerHeight": 4,
  "impellerThickness": 2,
  "bladeCount": 4,
  "innerThickness": 17,
  "innerMaxPos": 4,
  "innerCamber": 9,
  "innerChord": 7,
  "innerAngle": 9,
  "middlePos": 0.5,
  "middleChord": 25,
  "middleAngle": 6,
  "outerThickness": 13,
  "outerMaxPos": 7,
  "outerCamber": 6,
  "outerChord": 12,
  "outerAngle": 3
}""")
# Buggy Configs (solved 21.04.2026)
panel_4 = Panel("""{
  "impellerRadius": 76,
  "impellerHeight": 4,
  "impellerThickness": 2,
  "bladeCount": 3,
  "innerThickness": 23,
  "innerMaxPos": 5,
  "innerCamber": 4,
  "innerChord": 6,
  "innerAngle": 17,
  "middlePos": 0.5,
  "middleChord": 17,
  "middleAngle": 10,
  "outerThickness": 21,
  "outerMaxPos": 6,
  "outerCamber": 0,
  "outerChord": 11,
  "outerAngle": 3
}""")
panel_5 = Panel("""{
  "impellerRadius": 73,
  "impellerHeight": 4,
  "impellerThickness": 2,
  "bladeCount": 4,
  "innerThickness": 24,
  "innerMaxPos": 5,
  "innerCamber": 3,
  "innerChord": 8,
  "innerAngle": 8,
  "middlePos": 0.5,
  "middleChord": 16,
  "middleAngle": 5,
  "outerThickness": 8,
  "outerMaxPos": 6,
  "outerCamber": 8,
  "outerChord": 14,
  "outerAngle": 3
}""")
panel_6 = Panel("""{
  "impellerRadius": 61,
  "impellerHeight": 4,
  "impellerThickness": 2,
  "bladeCount": 6,
  "innerThickness": 23,
  "innerMaxPos": 5,
  "innerCamber": 3,
  "innerChord": 5,
  "innerAngle": 14,
  "middlePos": 0.5,
  "middleChord": 20,
  "middleAngle": 11,
  "outerThickness": 17,
  "outerMaxPos": 6,
  "outerCamber": 8,
  "outerChord": 10,
  "outerAngle": 2
}""")
panel_7 = Panel("""{
  "impellerRadius": 62,
  "impellerHeight": 4,
  "impellerThickness": 2,
  "bladeCount": 5,
  "innerThickness": 18,
  "innerMaxPos": 2,
  "innerCamber": 4,
  "innerChord": 7,
  "innerAngle": 2,
  "middlePos": 0.5,
  "middleChord": 27,
  "middleAngle": 2,
  "outerThickness": 13,
  "outerMaxPos": 5,
  "outerCamber": 7,
  "outerChord": 22,
  "outerAngle": 2
}""")
panel_8 = Panel("""{
  "impellerRadius": 75.0,
  "impellerHeight": 8.0,
  "impellerThickness": 1,
  "bladeCount": 3,
  "innerThickness": 5.0,
  "innerMaxPos": 3,
  "innerCamber": 3.0,
  "innerChord": 6.0,
  "innerAngle": 6.0,
  "middlePos": 0.4,
  "middleChord": 24.0,
  "middleAngle": 12.0,
  "outerThickness": 8.0,
  "outerMaxPos": 4,
  "outerCamber": 3,
  "outerChord": 21.0,
  "outerAngle": 18.0
}""")
panel_10 = Panel("""{
  "impellerRadius": 76,
  "impellerHeight": 10,
  "impellerThickness": 4,
  "bladeCount": 3,
  "innerThickness": 6,
  "innerMaxPos": 4,
  "innerCamber": 4,
  "innerChord": 11,
  "innerAngle": 25,
  "middlePos": 0.3,
  "middleChord": 20,
  "middleAngle": 15,
  "outerThickness": 6,
  "outerMaxPos": 4,
  "outerCamber": 4,
  "outerChord": 15,
  "outerAngle": 10
}""")

# ----
# Number of Points
# (adjust, if the calculation failes)
number_of_points_i = Slider(25, range=20..100)

# ---- group: Tip with text ID
topthickness = Slider(2, range=0..20)
height = Slider(7.28, range=0..20)
wallthickness = Slider(1, range=0..20)
tipplaneheight = Slider(5, range=0..20)
outerradius = Slider(8.28, range=0..20)
construct_point = ConstructPoint(
    XCoordinate=Slider(-6.1, range=-10..10),
    YCoordinate=Slider(-2.5, range=-10..10),
    ZCoordinate=Slider(13.7, range=-10..30))
construct_point_2 = ConstructPoint(XCoordinate=Slider(6.5, range=-10..10), YCoordinate=Slider(-3, range=-10..10), ZCoordinate=Slider(11.3, range=-10..30))
textinput = Text("<ID>")
unit_z = UnitZ(Factor=1)
construct_point_3 = ConstructPoint(XCoordinate=0, YCoordinate=0, ZCoordinate=tipplaneheight)
addition = Addition(A=tipplaneheight, B=height)
sheetid = GetString(textinput, AtLeast=1, AtMost=1, TreeAccess=False)
subtraction = Subtraction(A=height, B=topthickness)
subtraction_2 = Subtraction(A=wallthickness, B=outerradius)
plane = Plane(construct_point_3)
box_2pt = Box2Pt(PointA=construct_point_2, PointB=construct_point, Plane=PlaneXY(0, 0, 0))
pt = ConstructPoint(XCoordinate=Slider(0, range=-10..10), YCoordinate=Slider(0, range=-10..10), ZCoordinate=addition)
cylinder = Cylinder(Base=plane, Radius=outerradius, Length=height)
cylinder_2 = Cylinder(Base=plane, Radius=subtraction_2, Length=subtraction)
panel_11 = Panel(sheetid)
cone = Cone(Base=plane, Radius=subtraction_2, Length=subtraction)  # -> Cone, Tip
pl = PlaneNormal(Origin=pt, ZAxis=unit_z)
brep = Brep(cylinder)
brep_2 = Brep(cylinder_2)
brep_3 = Brep(cone.Cone)
c_script = CSharpScript(planeIn=pl, textIn=panel_11)  # -> out, text; inputs planeIn: Plane, textIn: String
# ---------- c_script: C# usings ----------
using Rhino.Geometry.Collections;
# ---------- c_script: C# ----------
 List<Brep> textBodies = new List<Brep>();
    Curve[] textCurvs = Curve.CreateTextOutlines(textIn, "Arial", 3, 0, true, planeIn, 7, 0.1);

    // --------- Center Text -------------------------------

    // Calculate bounding box of all curves
    BoundingBox bbox = BoundingBox.Empty;
    foreach (Curve crv in textCurvs)
        bbox.Union(crv.GetBoundingBox(true));

    // Find center of bounding box
    Point3d center = bbox.Center;

    // Compute translation vector to move center to plane origin
    Vector3d translation = planeIn.Origin - center;

    // Move curves to center them
    for (int i = 0; i < textCurvs.Length; i++)
        textCurvs[i].Translate(translation);

    // ----------------------------------------

    Vector3d dirVec = planeIn.Normal;


      //Vector3d extrudeDir = new Vector3d(dirVec.X * -1, dirVec.Y * -1, dirVec.Z * -1);
      dirVec.Reverse();

      foreach(Curve crv in textCurvs)
      {
        double extrudeDist = 1;

        Extrusion ribBody = Extrusion.Create(crv, extrudeDist, true);
        ribBody.SetPathAndUp(crv.PointAtStart, crv.PointAtEnd, dirVec);
        Brep closedRib = ribBody.ToBrep();

        Extrusion ribBodyB = Extrusion.Create(crv, -1 * extrudeDist, true);
        ribBodyB.SetPathAndUp(crv.PointAtStart, crv.PointAtEnd, dirVec);
        Brep closedRibB = ribBodyB.ToBrep();

        textBodies.Add(closedRib);
        textBodies.Add(closedRibB);
      }
      text = textBodies;
# ---------- end c_script ----------
cap_holes = CapHoles(Brep=brep)
cap_holes_2 = CapHoles(Brep=brep_2)
cap_holes_3 = CapHoles(Brep=brep_3)
underline = Brep(box_2pt)
solid_difference = SolidDifference(BrepsA=cap_holes, BrepsB=cap_holes_2)
solid_difference_2 = SolidDifference(BrepsA=cap_holes, BrepsB=cap_holes_3)
brep_4 = Brep(solid_difference)
tip = Brep(solid_difference_2)
text = Brep(c_script.text)
solid_difference_3 = SolidDifference(BrepsA=tip, BrepsB=text)
tipwithtext = Brep(solid_difference_3)
solid_difference_4 = SolidDifference(BrepsA=tipwithtext, ToSubtract=underline)
tip_text_underline = Brep(solid_difference_4)

# ----
# Inner NACA Profile
# Based on: https://www.grasshopper3d.com/profiles/blogs/naca-series-4-aerofoil-generator
thickness_i_chord_2 = Slider(6, range=3..24)
high_point_i_10ths_chord_2 = Slider(4, range=2..8)
camber_i_chord_2 = Slider(4, range=0..9)
angle_i_degree_2 = Slider(25, range=2..25)
chord_i_mm_2 = Slider(11, range=3..11)
innerthickness = GetNumber(
    inputjsoninterpreter.innerThickness,
    AtLeast=3,
    AtMost=2147483647,
    Maximum=1.797693135e+308,
    Minimum=-1.797693135e+308,
    TreeAccess=False)
innermaxpos = GetNumber(
    inputjsoninterpreter.innerMaxPos,
    AtLeast=2,
    AtMost=2147483647,
    Maximum=1.797693135e+308,
    Minimum=-1.797693135e+308,
    TreeAccess=False)
innercamber = GetNumber(
    inputjsoninterpreter.innerCamber,
    AtLeast=0,
    AtMost=2147483647,
    Maximum=1.797693135e+308,
    Minimum=-1.797693135e+308,
    TreeAccess=False)
innerchord = GetNumber(
    inputjsoninterpreter.innerChord,
    AtLeast=3,
    AtMost=2147483647,
    Maximum=1.797693135e+308,
    Minimum=-1.797693135e+308,
    TreeAccess=False)
innerangle = GetNumber(
    inputjsoninterpreter.innerAngle,
    AtLeast=2,
    AtMost=2147483647,
    Maximum=1.797693135e+308,
    Minimum=-1.797693135e+308,
    TreeAccess=False)
c_script_2 = CSharpScript(
    countI=number_of_points_i,
    thicknessI=innerthickness,
    highPointI=innermaxpos,
    camberI=innercamber,
    chordI=innerchord,
    angleIDeg=innerangle)  # -> out, profileOut, profileLog; inputs countI: Int32, thicknessI: Double, highPointI: Double, camberI: Double, chordI: Double, angleIDeg: Double
# ---------- c_script_2: C# ----------
// Grasshopper Script Instance
#region Usings
using System;
using System.Linq;
using System.Collections;
using System.Collections.Generic;
using System.Drawing;

using Rhino;
using Rhino.Geometry;
using Rhino.Geometry.Morphs;

using Grasshopper;
using Grasshopper.Kernel;
using Grasshopper.Kernel.Data;
using Grasshopper.Kernel.Types;
#endregion

public class Script_Instance : GH_ScriptInstance
{
    #region Notes
    /* 
      Members:
        RhinoDoc RhinoDocument
        GH_Document GrasshopperDocument
        IGH_Component Component
        int Iteration

      Methods (Virtual & overridable):
        Print(string teYt)
        Print(string format, params object[] args)
        Reflect(object obj)
        Reflect(object obj, string method_name)
    */
    #endregion

    private void RunScript(
		int countI,
		double thicknessI,
		double highPointI,
		double camberI,
		double chordI,
		double angleIDeg,
		ref object profileOut,
		ref object profileLog)
    {

        // Symmetric Profile
        
        countI += 1;
        double unit = 1.0/Convert.ToDouble(countI);
        double[] samplingArray = Enumerable.Range(0, countI).Select(i => (double)i / (countI - 1)).ToArray();
        double[] cosArray = samplingArray.Select(Math.Cos).ToArray(); 
        double start=cosArray[0], end=cosArray.Last(), start2=0.0, end2=1.0;
        double[] remappedArray = cosArray.Select(val => start2 + (val - start) * (end2 - start2) / (end - start)).ToArray();
        
        // Y values
        double[] culledY = remappedArray[1..];
        double[] revertedY = remappedArray.Reverse().ToArray(); 
        double[] combinedY = revertedY.Concat(culledY).ToArray();

        // Z values
        double thicknessNormalized = thicknessI*0.01;
        double[] arrayZVal = remappedArray.Select(Y => (thicknessNormalized / 0.2) * (0.2969 * Math.Sqrt(Y) - 0.126 * Y - 0.3516 * Math.Pow(Y, 2) + 0.2843 * Math.Pow(Y, 3) - 0.1015 * Math.Pow(Y, 4))).ToArray();
        double[] culledZ = arrayZVal[1..];
        double[] revertedZ = arrayZVal.Select(z => -z).Reverse().ToArray();
        double[] combinedZ = revertedZ.Concat(culledZ).ToArray();

        // pointsNormalized
        Point3d[] points = new Point3d[combinedY.Length];

        for (int i = 0; i < combinedY.Length; i++)
        {
            points[i] = new Point3d(0, combinedY[i], combinedZ[i]);
        }

        Curve profileCurve = Curve.CreateInterpolatedCurve(points,5,CurveKnotStyle.ChordSquareRoot);

        // Camber Curve
        double highPointFactor = highPointI*0.1;
        double camberFactor = camberI*0.01;

        double[] firstArray = Enumerable.Range(0, Convert.ToInt16(highPointI + 1)).Select(i => i * 0.1).ToArray();
        double[] secondArray = Enumerable.Range(Convert.ToInt16(highPointI+1), 10 - Convert.ToInt16(highPointI)).Select(i => i * 0.1).ToArray();

        double[] functionsFirst = firstArray.Select(x => (camberFactor / (highPointFactor * highPointFactor)) * (2 * highPointFactor * x - x * x)).ToArray();
        double[] functionsSecond = secondArray.Select(x => (camberFactor / Math.Pow(1 - highPointFactor, 2)) * ((1 - 2 * highPointFactor) + 2 * highPointFactor * x - x * x)).ToArray();

        Point3d[] pointsCamber = new Point3d[11];

        for (int i = 0; i < firstArray.Length; i++)
        {
            pointsCamber[i] = new Point3d(0, firstArray[i], functionsFirst[i]);
        }

        for (int i = 0; i < secondArray.Length; i++)
        {
            pointsCamber[i+Convert.ToInt16(highPointI)+1] = new Point3d(0, secondArray[i], functionsSecond[i]);
        }

        Curve flowCurve = Curve.CreateInterpolatedCurve(pointsCamber,5,CurveKnotStyle.ChordSquareRoot);

        Curve fittedFlow = flowCurve.Fit(5,0.01,0.01);

        Curve straightCrv = new LineCurve(fittedFlow.PointAtStart,fittedFlow.PointAtEnd);

        
        // Morphed Curve
        FlowSpaceMorph morphCamber = new FlowSpaceMorph(straightCrv,fittedFlow,true);
        Curve morphile = (Rhino.Geometry.Curve) profileCurve.Duplicate();
        morphCamber.Morph(morphile);

        // Scaled curve
        Curve scalephile = (Rhino.Geometry.Curve) morphile.Duplicate();
        scalephile.Scale(chordI);

        // Mirror Curve
        Point3d planeOrig = new Point3d(0,chordI/4,0);
        Plane mirrorPlane = new Plane(planeOrig,Vector3d.YAxis);

        //Curve mirrorCrv = (Rhino.Geometry.Curve) joinedOffset[0].Duplicate();
        Curve mirrorCrv = (Rhino.Geometry.Curve) scalephile.Duplicate();
        Transform mirrorOperation = Transform.Mirror(mirrorPlane);
        mirrorCrv.Transform(mirrorOperation);

        //Angled Profile
        Curve angleCrv = (Rhino.Geometry.Curve) mirrorCrv.Duplicate();
        Transform rotationOperation = Transform.Rotation(angleIDeg/180*Math.PI,Vector3d.XAxis,Point3d.Origin);
        angleCrv.Rotate(angleIDeg/180*Math.PI,Vector3d.XAxis,Point3d.Origin);

        // Move to position
        Curve finalProfile = (Rhino.Geometry.Curve) angleCrv.Duplicate();
        Transform moveToTarget = Transform.Translation(new Vector3d(4,0,0));
        finalProfile.Transform(moveToTarget);
        profileOut = finalProfile;

        // Compute Logtext
        string nacaType = camberI.ToString() + highPointI.ToString();
        int thicknessLength = Convert.ToString(thicknessI).Length;
        if(thicknessLength == 1) nacaType += "0" + Convert.ToString(thicknessI);
        else if(thicknessLength == 2) nacaType += Convert.ToString(thicknessI);
        
        double maxThickness = thicknessI*0.01*chordI+0.2;
        nacaType = "NACA profile " + nacaType +". Largest Thickness: "+ Convert.ToString(Math.Round(maxThickness,3)) + " mm.";
        profileLog = nacaType;



    }
}
# ---------- end c_script_2 ----------

launcherinterface = Brep(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)

# ----
# Outer Circle
radius_of_the_impeller_2 = Slider(70, range=60..80)
hight_of_the_impeller_2 = Slider(6, range=4..10)
thickness_of_the_outer_ring_2 = Slider(3, range=1..5)
impellerradius = GetNumber(
    inputjsoninterpreter.impellerRadius,
    AtLeast=60,
    AtMost=80,
    Maximum=1.797693135e+308,
    Minimum=-1.797693135e+308,
    TreeAccess=False)
impellerthickness = GetNumber(
    inputjsoninterpreter.impellerThickness,
    AtLeast=1,
    AtMost=5,
    Maximum=1.797693135e+308,
    Minimum=-1.797693135e+308,
    TreeAccess=False)
impellerheight = GetNumber(
    inputjsoninterpreter.impellerHeight,
    AtLeast=4,
    AtMost=10,
    Maximum=1.797693135e+308,
    Minimum=-1.797693135e+308,
    TreeAccess=False)

# ----
# Outer NACA Profile
# Based on: https://www.grasshopper3d.com/profiles/blogs/naca-series-4-aerofoil-generator
camber_o_chord_2 = Slider(4, range=0..9)
thickness_o_chord_2 = Slider(6, range=3..24)
high_point_o_10ths_chord_2 = Slider(4, range=2..8)
chord_o_mm_2 = Slider(15, range=10..30)
angle_o_degree_2 = Slider(10, range=2..25)
outerthickness = GetNumber(
    inputjsoninterpreter.outerThickness,
    AtLeast=3,
    AtMost=2147483647,
    Maximum=1.797693135e+308,
    Minimum=-1.797693135e+308,
    TreeAccess=False)
outermaxpos = GetNumber(
    inputjsoninterpreter.outerMaxPos,
    AtLeast=2,
    AtMost=2147483647,
    Maximum=1.797693135e+308,
    Minimum=-1.797693135e+308,
    TreeAccess=False)
outercamber = GetNumber(
    inputjsoninterpreter.outerCamber,
    AtLeast=0,
    AtMost=2147483647,
    Maximum=1.797693135e+308,
    Minimum=-1.797693135e+308,
    TreeAccess=False)
outerchord = GetNumber(
    inputjsoninterpreter.outerChord,
    AtLeast=10,
    AtMost=2147483647,
    Maximum=1.797693135e+308,
    Minimum=-1.797693135e+308,
    TreeAccess=False)
outerangle = GetNumber(
    inputjsoninterpreter.outerAngle,
    AtLeast=2,
    AtMost=2147483647,
    Maximum=1.797693135e+308,
    Minimum=-1.797693135e+308,
    TreeAccess=False)
c_script_3 = CSharpScript(
    countI=number_of_points_i,
    thicknessI=outerthickness,
    highPointI=outermaxpos,
    camberI=outercamber,
    chordI=outerchord,
    angleIDeg=outerangle,
    radius=impellerradius)  # -> out, profileOut, impellerHeight, profileLog; inputs countI: Int32, thicknessI: Double, highPointI: Double, camberI: Double, chordI: Double, angleIDeg: Double, radius: Double
# ---------- c_script_3: C# ----------
// Grasshopper Script Instance
#region Usings
using System;
using System.Linq;
using System.Collections;
using System.Collections.Generic;
using System.Drawing;

using Rhino;
using Rhino.Geometry;
using Rhino.Geometry.Morphs;

using Grasshopper;
using Grasshopper.Kernel;
using Grasshopper.Kernel.Data;
using Grasshopper.Kernel.Types;
#endregion

public class Script_Instance : GH_ScriptInstance
{
    #region Notes
    /* 
      Members:
        RhinoDoc RhinoDocument
        GH_Document GrasshopperDocument
        IGH_Component Component
        int Iteration

      Methods (Virtual & overridable):
        Print(string teYt)
        Print(string format, params object[] args)
        Reflect(object obj)
        Reflect(object obj, string method_name)
    */
    #endregion

    private void RunScript(
		int countI,
		double thicknessI,
		double highPointI,
		double camberI,
		double chordI,
		double angleIDeg,
		double radius,
		ref object profileOut,
		ref object impellerHeight,
		ref object profileLog)
    {

        // Symmetric Profile
        
        countI += 1;
        double unit = 1.0/Convert.ToDouble(countI);
        double[] samplingArray = Enumerable.Range(0, countI).Select(i => (double)i / (countI - 1)).ToArray();
        double[] cosArray = samplingArray.Select(Math.Cos).ToArray(); 
        double start=cosArray[0], end=cosArray.Last(), start2=0.0, end2=1.0;
        double[] remappedArray = cosArray.Select(val => start2 + (val - start) * (end2 - start2) / (end - start)).ToArray();
        
        // Y values
        double[] culledY = remappedArray[1..];
        double[] revertedY = remappedArray.Reverse().ToArray(); 
        double[] combinedY = revertedY.Concat(culledY).ToArray();

        // Z values
        double thicknessNormalized = thicknessI*0.01;
        double[] arrayZVal = remappedArray.Select(Y => (thicknessNormalized / 0.2) * (0.2969 * Math.Sqrt(Y) - 0.126 * Y - 0.3516 * Math.Pow(Y, 2) + 0.2843 * Math.Pow(Y, 3) - 0.1015 * Math.Pow(Y, 4))).ToArray();
        double[] culledZ = arrayZVal[1..];
        double[] revertedZ = arrayZVal.Select(z => -z).Reverse().ToArray();
        double[] combinedZ = revertedZ.Concat(culledZ).ToArray();

        // pointsNormalized
        Point3d[] points = new Point3d[combinedY.Length];

        for (int i = 0; i < combinedY.Length; i++)
        {
            points[i] = new Point3d(0, combinedY[i], combinedZ[i]);
        }

        Curve profileCurve = Curve.CreateInterpolatedCurve(points,5,CurveKnotStyle.ChordSquareRoot);

        // Camber Curve
        double highPointFactor = highPointI*0.1;
        double camberFactor = camberI*0.01;

        double[] firstArray = Enumerable.Range(0, Convert.ToInt16(highPointI + 1)).Select(i => i * 0.1).ToArray();
        double[] secondArray = Enumerable.Range(Convert.ToInt16(highPointI+1), 10 - Convert.ToInt16(highPointI)).Select(i => i * 0.1).ToArray();

        double[] functionsFirst = firstArray.Select(x => (camberFactor / (highPointFactor * highPointFactor)) * (2 * highPointFactor * x - x * x)).ToArray();
        double[] functionsSecond = secondArray.Select(x => (camberFactor / Math.Pow(1 - highPointFactor, 2)) * ((1 - 2 * highPointFactor) + 2 * highPointFactor * x - x * x)).ToArray();

        Point3d[] pointsCamber = new Point3d[11];

        for (int i = 0; i < firstArray.Length; i++)
        {
            pointsCamber[i] = new Point3d(0, firstArray[i], functionsFirst[i]);
        }

        for (int i = 0; i < secondArray.Length; i++)
        {
            pointsCamber[i+Convert.ToInt16(highPointI)+1] = new Point3d(0, secondArray[i], functionsSecond[i]);
        }

        Curve flowCurve = Curve.CreateInterpolatedCurve(pointsCamber,5,CurveKnotStyle.ChordSquareRoot);

        Curve fittedFlow = flowCurve.Fit(5,0.01,0.01);

        Curve straightCrv = new LineCurve(fittedFlow.PointAtStart,fittedFlow.PointAtEnd);

        // Morphed Curve
        FlowSpaceMorph morphCamber = new FlowSpaceMorph(straightCrv,fittedFlow,true);
        Curve morphile = (Rhino.Geometry.Curve) profileCurve.Duplicate();
        morphCamber.Morph(morphile);

        // Scaled curve
        Curve scalephile = (Rhino.Geometry.Curve) morphile.Duplicate();
        scalephile.Scale(chordI);

        // Mirror Curve
        Point3d planeOrig = new Point3d(0,chordI/4,0);
        Plane mirrorPlane = new Plane(planeOrig,Vector3d.YAxis);

        //Curve mirrorCrv = (Rhino.Geometry.Curve) joinedOffset[0].Duplicate();
        Curve mirrorCrv = (Rhino.Geometry.Curve) scalephile.Duplicate();
        Transform mirrorOperation = Transform.Mirror(mirrorPlane);
        mirrorCrv.Transform(mirrorOperation);

        //Angled Profile
        Curve angleCrv = (Rhino.Geometry.Curve) mirrorCrv.Duplicate();
        Transform rotationOperation = Transform.Rotation(angleIDeg/180*Math.PI,Vector3d.XAxis,Point3d.Origin);
        angleCrv.Rotate(angleIDeg/180*Math.PI,Vector3d.XAxis,Point3d.Origin);

        // Move to position
        Curve finalProfile = (Rhino.Geometry.Curve) angleCrv.Duplicate();
        Transform moveToTarget = Transform.Translation(new Vector3d(radius,0,0));
        finalProfile.Transform(moveToTarget);
        profileOut = finalProfile;

        // Impeller height

        BoundingBox bb = finalProfile.GetBoundingBox(true);
        double clearance = 1.0; // or make this an input
        impellerHeight = (bb.Max.Z - bb.Min.Z) + 2.0 * clearance;

        // Compute Logtext
        string nacaType = camberI.ToString() + highPointI.ToString();
        int thicknessLength = Convert.ToString(thicknessI).Length;
        if(thicknessLength == 1) nacaType += "0" + Convert.ToString(thicknessI);
        else if(thicknessLength == 2) nacaType += Convert.ToString(thicknessI);
        
        double maxThickness = thicknessI*0.01*chordI+0.2;
        nacaType = "NACA profile " + nacaType +". Largest Thickness: "+ Convert.ToString(Math.Round(maxThickness,3)) + " mm.";
        profileLog = nacaType;




    }
}
# ---------- end c_script_3 ----------

distance_to_middle_naca_times_radius_2 = Slider(0.3, range=0.3..0.7)
middlepos = GetNumber(
    inputjsoninterpreter.middlePos,
    AtLeast=0,
    AtMost=2147483647,
    Maximum=1.797693135e+308,
    Minimum=-1.797693135e+308,
    TreeAccess=False)
angle_m_degree_2 = Slider(15, range=2..25)
chord_m_mm_2 = Slider(20, range=10..30)
c_script_4 = CSharpScript(
    pos=middlepos,
    thicknessI=innerthickness,
    thicknessO=outerthickness,
    highPtI=innermaxpos,
    highPtO=outermaxpos,
    camberI=innercamber,
    camberO=outercamber,
    radius=impellerradius)  # -> out, thicknessM, highPtM, camberM, radiusM; inputs pos: Double, thicknessI: Double, thicknessO: Double, highPtI: Double, highPtO: Double, camberI: Double, camberO: Double, radius: Double
# ---------- c_script_4: C# ----------
// Grasshopper Script Instance
#region Usings
using System;
using Rhino;
using Rhino.Geometry;
using Grasshopper;
using Grasshopper.Kernel;
#endregion

public class Script_Instance : GH_ScriptInstance
{
    #region Notes
    /*
      Members:
        RhinoDoc RhinoDocument
        GH_Document GrasshopperDocument
        IGH_Component Component
        int Iteration
    */
    #endregion

    private void RunScript(
		double pos,
		double thicknessI,
		double thicknessO,
		double highPtI,
		double highPtO,
		double camberI,
		double camberO,
		double radius,
		ref object thicknessM,
		ref object highPtM,
		ref object camberM,
		ref object radiusM)
    {
        // Keep interpolation parameter in a safe range
        double t = Math.Max(0.0, Math.Min(1.0, pos));

        // Linear interpolation
        double thM = thicknessI + (thicknessO - thicknessI) * t;
        double hpM = highPtI   + (highPtO   - highPtI)   * t;
        double cbM = camberI   + (camberO   - camberI)   * t;

        // Original logic preserved:
        // inner radius assumed at 4, outer at 'radius'
        double rM = 4.0 + (radius - 4.0) * t;

        thicknessM = thM;
        highPtM = hpM;
        camberM = cbM;
        radiusM = rM;
    }
}
# ---------- end c_script_4 ----------
middlechord = GetNumber(
    inputjsoninterpreter.middleChord,
    AtLeast=10,
    AtMost=2147483647,
    Maximum=1.797693135e+308,
    Minimum=-1.797693135e+308,
    TreeAccess=False)
middleangle = GetNumber(
    inputjsoninterpreter.middleAngle,
    AtLeast=2,
    AtMost=2147483647,
    Maximum=1.797693135e+308,
    Minimum=-1.797693135e+308,
    TreeAccess=False)
c_script_5 = CSharpScript(
    countI=number_of_points_i,
    thicknessI=c_script_4.thicknessM,
    highPointI=c_script_4.highPtM,
    camberI=c_script_4.camberM,
    radius=c_script_4.radiusM,
    chordI=middlechord,
    angleIDeg=middleangle)  # -> out, profileOut, impellerHeight, profileLog; inputs countI: Int32, thicknessI: Double, highPointI: Double, camberI: Double, radius: Double, chordI: Double, angleIDeg: Double
# ---------- c_script_5: C# ----------
// Grasshopper Script Instance
#region Usings
using System;
using System.Linq;
using System.Collections.Generic;
using Rhino;
using Rhino.Geometry;
using Rhino.Geometry.Morphs;
using Grasshopper;
using Grasshopper.Kernel;
#endregion

public class Script_Instance : GH_ScriptInstance
{
    #region Notes
    /*
      Members:
        RhinoDoc RhinoDocument
        GH_Document GrasshopperDocument
        IGH_Component Component
        int Iteration
    */
    #endregion

    private void RunScript(
		int countI,
		double thicknessI,
		double highPointI,
		double camberI,
		double radius,
		double chordI,
		double angleIDeg,
		ref object profileOut,
		ref object impellerHeight,
		ref object profileLog)
    {
        try
        {
            // -----------------------------
            // Basic input validation
            // -----------------------------
            if (countI < 2)
            {
                profileOut = null;
                profileLog = "Invalid input: countI must be at least 2.";
                return;
            }

            if (chordI <= 0.0)
            {
                profileOut = null;
                profileLog = "Invalid input: chordI must be > 0.";
                return;
            }

            if (thicknessI <= 0.0)
            {
                profileOut = null;
                profileLog = "Invalid input: thicknessI must be > 0.";
                return;
            }

            // highPointI is expected in NACA-style tenths, e.g. 2..7
            // Convert to normalized [0,1]
            double highPointFactor = highPointI * 0.1;
            highPointFactor = Math.Max(0.001, Math.Min(0.999, highPointFactor));

            double camberFactor = camberI * 0.01;
            double thicknessNormalized = thicknessI * 0.01;

            // -----------------------------
            // 1) Build symmetric thickness profile in normalized coordinates
            //    x along chord in [0,1], z thickness about 0
            // -----------------------------
            int sampleCount = countI + 1;
            double[] xTop = Enumerable.Range(0, sampleCount)
                                      .Select(i => (double)i / (sampleCount - 1))
                                      .ToArray();

            // NACA thickness distribution
            double[] zTop = xTop.Select(x =>
            {
                double sqrtX = (x <= 0.0) ? 0.0 : Math.Sqrt(x);
                return (thicknessNormalized / 0.2) *
                       (0.2969 * sqrtX
                      - 0.1260 * x
                      - 0.3516 * x * x
                      + 0.2843 * x * x * x
                      - 0.1015 * x * x * x * x);
            }).ToArray();

            // Build closed-ish profile point set:
            // lower surface from TE -> LE, then upper from LE -> TE
            List<Point3d> profilePts = new List<Point3d>();

            for (int i = sampleCount - 1; i >= 0; i--)
                profilePts.Add(new Point3d(0, xTop[i], -zTop[i]));

            for (int i = 1; i < sampleCount; i++)
                profilePts.Add(new Point3d(0, xTop[i], zTop[i]));

            Curve profileCurve = Curve.CreateInterpolatedCurve(
                profilePts,
                3,
                CurveKnotStyle.Chord
            );

            if (profileCurve == null || !profileCurve.IsValid)
            {
                profileOut = null;
                profileLog = "Failed to create base thickness profile.";
                return;
            }

            // -----------------------------
            // 2) Build camber curve continuously
            //    No integer rounding of highPointI
            // -----------------------------
            int camberSamples = 21;
            Point3d[] pointsCamber = new Point3d[camberSamples];

            for (int i = 0; i < camberSamples; i++)
            {
                double x = (double)i / (camberSamples - 1);
                double z;

                if (x <= highPointFactor)
                {
                    z = (camberFactor / (highPointFactor * highPointFactor)) *
                        (2.0 * highPointFactor * x - x * x);
                }
                else
                {
                    double denom = Math.Pow(1.0 - highPointFactor, 2);
                    z = (camberFactor / denom) *
                        ((1.0 - 2.0 * highPointFactor) + 2.0 * highPointFactor * x - x * x);
                }

                pointsCamber[i] = new Point3d(0, x, z);
            }

            Curve flowCurve = Curve.CreateInterpolatedCurve(
                pointsCamber,
                3,
                CurveKnotStyle.Chord
            );

            if (flowCurve == null || !flowCurve.IsValid)
            {
                profileOut = null;
                profileLog = "Failed to create camber curve.";
                return;
            }

            // Straight reference curve for morph
            Curve straightCrv = new LineCurve(
                new Point3d(0, 0, 0),
                new Point3d(0, 1, 0)
            );

            // -----------------------------
            // 3) Morph symmetric thickness profile onto camber line
            // -----------------------------
            Curve morphedProfile = profileCurve.DuplicateCurve();

            FlowSpaceMorph morphCamber = new FlowSpaceMorph(straightCrv, flowCurve, true);
            morphCamber.Morph(morphedProfile);

            if (morphedProfile == null || !morphedProfile.IsValid)
            {
                profileOut = null;
                profileLog = "Failed during camber morph.";
                return;
            }

            // -----------------------------
            // 4) Scale by chord
            // -----------------------------
            Curve scaledProfile = morphedProfile.DuplicateCurve();
            Transform scaleXform = Transform.Scale(Point3d.Origin, chordI);
            scaledProfile.Transform(scaleXform);

            // -----------------------------
            // 5) Mirror
            // Preserving your original logic
            // -----------------------------
            Point3d planeOrig = new Point3d(0, chordI / 4.0, 0);
            Plane mirrorPlane = new Plane(planeOrig, Vector3d.YAxis);

            Curve mirrorCrv = scaledProfile.DuplicateCurve();
            Transform mirrorOperation = Transform.Mirror(mirrorPlane);
            mirrorCrv.Transform(mirrorOperation);

            // -----------------------------
            // 6) Rotate by angle
            // -----------------------------
            Curve angleCrv = mirrorCrv.DuplicateCurve();
            double angleRad = angleIDeg * Math.PI / 180.0;
            angleCrv.Rotate(angleRad, Vector3d.XAxis, Point3d.Origin);

            // -----------------------------
            // 7) Move to radius position
            // -----------------------------
            Curve finalProfile = angleCrv.DuplicateCurve();
            Transform moveToTarget = Transform.Translation(new Vector3d(radius, 0, 0));
            finalProfile.Transform(moveToTarget);

            if (finalProfile == null || !finalProfile.IsValid)
            {
                profileOut = null;
                profileLog = "Final profile is invalid.";
                return;
            }

            profileOut = finalProfile;

            // -----------------------------
            // 8) Log text
            // -----------------------------
            string camberStr = Math.Round(camberI, 3).ToString();
            string highPtStr = Math.Round(highPointI, 3).ToString();
            string thickStr = Math.Round(thicknessI, 3).ToString();

            double maxThickness = thicknessNormalized * chordI;
            string log = "Interpolated NACA-like profile"
                       + " | camber=" + camberStr
                       + " | highPoint=" + highPtStr
                       + " | thickness=" + thickStr
                       + " | chord=" + Math.Round(chordI, 3).ToString()
                       + " | approx max thickness=" + Math.Round(maxThickness, 3).ToString() + " mm.";

            profileLog = log;
        }
        catch (Exception ex)
        {
            profileOut = null;
            profileLog = "Exception: " + ex.Message;
        }
    }
}
# ---------- end c_script_5 ----------

max = Maximum(A=impellerheight, B=c_script_3.impellerHeight)
c_script_6 = CSharpScript(outerProfile=c_script_3.profileOut, clearance=Slider(1, range=0..5))  # -> out, impellerHeight, ringBottomZ, ringTopZ, log; inputs outerProfile: Curve, clearance: Double
# ---------- c_script_6: C# ----------
// Grasshopper Script Instance
#region Usings
using System;
using Rhino;
using Rhino.Geometry;
using Grasshopper;
using Grasshopper.Kernel;
#endregion

public class Script_Instance : GH_ScriptInstance
{
    private void RunScript(
		Curve outerProfile,
		double clearance,
		ref object impellerHeight,
		ref object ringBottomZ,
		ref object ringTopZ,
		ref object log)
    {
        if (outerProfile == null || !outerProfile.IsValid)
        {
            impellerHeight = null;
            ringBottomZ = null;
            ringTopZ = null;
            log = "Invalid outer profile.";
            return;
        }

        BoundingBox bb = outerProfile.GetBoundingBox(true);

        if (!bb.IsValid)
        {
            impellerHeight = null;
            ringBottomZ = null;
            ringTopZ = null;
            log = "Could not compute bounding box.";
            return;
        }

        double zMin = bb.Min.Z;
        double zMax = bb.Max.Z;

        ringBottomZ = zMin - clearance;
        ringTopZ = zMax + clearance;
        impellerHeight = (zMax - zMin) + 2.0 * clearance;

        log = "Outer profile Z range: ["
            + Math.Round(zMin, 3).ToString() + ", "
            + Math.Round(zMax, 3).ToString() + "] mm"
            + " | impellerHeight = "
            + Math.Round((double)impellerHeight, 3).ToString() + " mm.";
    }
}
# ---------- end c_script_6 ----------
c_script_7 = CSharpScript(
    impellerRad=impellerradius,
    impellerH=max,
    impellerThick=impellerthickness,
    ringTopZ=c_script_6.ringTopZ,
    ringBottomZ=c_script_6.ringBottomZ,
    safetyMargin=Slider(0.5, range=0..5))  # -> out, ellipse, ringCircle, ring, usedHeight, log; inputs impellerRad: Double, impellerH: Double, impellerThick: Double, ringTopZ: Double, ringBottomZ: Double, safetyMargin: Double
# ---------- c_script_7: C# ----------
// Grasshopper Script Instance
#region Usings
using System;
using System.Linq;
using System.Collections;
using System.Collections.Generic;
using System.Drawing;

using Rhino;
using Rhino.Geometry;

using Grasshopper;
using Grasshopper.Kernel;
using Grasshopper.Kernel.Data;
using Grasshopper.Kernel.Types;
#endregion

public class Script_Instance : GH_ScriptInstance
{
    #region Notes
    /* 
      Members:
        RhinoDoc RhinoDocument
        GH_Document GrasshopperDocument
        IGH_Component Component
        int Iteration

      Methods (Virtual & overridable):
        Print(string text)
        Print(string format, params object[] args)
        Reflect(object obj)
        Reflect(object obj, string method_name)
    */
    #endregion

    private void RunScript(
		double impellerRad,
		double impellerH,
		double impellerThick,
		double ringTopZ,
		double ringBottomZ,
		double safetyMargin,
		ref object ellipse,
		ref object ringCircle,
		ref object ring,
		ref object usedHeight,
		ref object log)
    {
        // Height required to contain the outer profile
        double fittedHeight = ringTopZ - ringBottomZ;

        // Mid-plane of the fitted profile envelope
        double centerZ = 0.5 * (ringTopZ + ringBottomZ);

        // Use input impellerH only if it exceeds required fitted height by safety margin
        double finalHeight;
        bool usedInputHeight;

        if (impellerH >= fittedHeight + safetyMargin)
        {
            finalHeight = impellerH;
            usedInputHeight = true;
        }
        else
        {
            finalHeight = fittedHeight;
            usedInputHeight = false;
        }

        // Build ellipse centered on the ring envelope midpoint
        Point3d ellipseCenterPt = new Point3d(impellerRad, 0, centerZ);
        Plane ellipsePlane = new Plane(ellipseCenterPt, Vector3d.XAxis, Vector3d.ZAxis);

        Rhino.Geometry.Ellipse ellipseCS = new Rhino.Geometry.Ellipse(
            ellipsePlane,
            impellerThick / 2.0,
            finalHeight / 2.0
        );

        Curve ellipseCrv = ellipseCS.ToNurbsCurve();
        ellipse = ellipseCrv;

        // Sweep around impeller radius
        Circle railCirc = new Circle(Plane.WorldXY, impellerRad);
        Curve circleCurve = railCirc.ToNurbsCurve();

        ringCircle = circleCurve;

        Brep[] ringSweep = Brep.CreateFromSweep(circleCurve, ellipseCrv, true, 0.01);

        if (ringSweep != null && ringSweep.Length > 0)
        {
            ring = ringSweep[0];
        }
        else
        {
            ring = null;
        }

        usedHeight = finalHeight;

        log = usedInputHeight
            ? "Used input impellerH. Input height = " + Math.Round(impellerH, 3).ToString()
              + " mm, fitted height = " + Math.Round(fittedHeight, 3).ToString()
              + " mm, safety margin = " + Math.Round(safetyMargin, 3).ToString() + " mm."
            : "Used fitted ring height from outer profile envelope. Fitted height = "
              + Math.Round(fittedHeight, 3).ToString()
              + " mm, input impellerH = " + Math.Round(impellerH, 3).ToString()
              + " mm, safety margin = " + Math.Round(safetyMargin, 3).ToString() + " mm.";
    }
}
# ---------- end c_script_7 ----------
data = Data(c_script_7.ellipse)
data_2 = Data(c_script_7.ringCircle)
data_3 = Data(c_script_7.ring)

# ---- group: Inner Trim of Blades and Simplified Interface
amount_of_blades_2 = Slider(3, range=3..6)
bladecount = GetNumber(
    inputjsoninterpreter.bladeCount,
    AtLeast=3,
    AtMost=6,
    Maximum=1.797693135e+308,
    Minimum=-1.797693135e+308,
    TreeAccess=False)
c_script_8 = CSharpScript(
    profileI=c_script_2.profileOut,
    profileM=c_script_5.profileOut,
    profileO=c_script_3.profileOut,
    profileCount=bladecount,
    height=max,
    interfaceIn=launcherinterface)  # -> out, simplifiedInterface, untrimmedBladeOut, bladesOut; inputs profileI: Curve, profileM: Curve, profileO: Curve, profileCount: Int32, height: Double, interfaceIn: Brep
# ---------- c_script_8: C# ----------
// Grasshopper Script Instance
#region Usings
using System;
using System.Linq;
using System.Collections;
using System.Collections.Generic;
using System.Drawing;

using Rhino;
using Rhino.Geometry;

using Grasshopper;
using Grasshopper.Kernel;
using Grasshopper.Kernel.Data;
using Grasshopper.Kernel.Types;
#endregion

public class Script_Instance : GH_ScriptInstance
{
    #region Notes
    /* 
      Members:
        RhinoDoc RhinoDocument
        GH_Document GrasshopperDocument
        IGH_Component Component
        int Iteration

      Methods (Virtual & overridable):
        Print(string text)
        Print(string format, params object[] args)
        Reflect(object obj)
        Reflect(object obj, string method_name)
    */
    #endregion

    private void RunScript(
		Curve profileI,
		Curve profileM,
		Curve profileO,
		int profileCount,
		double height,
		Brep interfaceIn,
		ref object simplifiedInterface,
		ref object untrimmedBladeOut,
		ref object bladesOut)
    {
        double tol = profileI.PointAtStart.DistanceTo(profileI.PointAtEnd);
        profileI.MakeClosed(tol+0.002);
        tol = profileM.PointAtStart.DistanceTo(profileM.PointAtEnd);
        profileM.MakeClosed(tol+0.002);
        tol = profileO.PointAtStart.DistanceTo(profileO.PointAtEnd);
        profileO.MakeClosed(tol+0.002);
        List<Curve> profileCurves = new List<Curve>();
        profileCurves.Add(profileI);
        profileCurves.Add(profileM);
        profileCurves.Add(profileO);
        List<Point3d> startRail = new List<Point3d>(){profileI.PointAtStart,profileM.PointAtStart,profileO.PointAtStart};
        Curve railStart = Curve.CreateInterpolatedCurve(startRail,3,CurveKnotStyle.Chord);
        
        List<Point3d> midRail = new List<Point3d>(){profileI.PointAtMid,profileM.PointAtMid,profileO.PointAtMid};
        Curve railMid = Curve.CreateInterpolatedCurve(midRail,3,CurveKnotStyle.Chord);

        List<Curve> rails = new List<Curve>() {railStart,railMid};

        Brep[] profileLoft = Brep.CreateFromSweep(railStart,railMid,profileCurves, true,0.01);

        Brep[] startCap = Brep.CreatePlanarBreps(profileI,0.01);
        Brep[] endCap = Brep.CreatePlanarBreps(profileO,0.01);
        Brep closedLoft = profileLoft[0].CapPlanarHoles(0.02);

        Point3d circleMid = new Point3d(0,0,-2*height);
        Plane circlePlane = new Plane(circleMid,Vector3d.XAxis,Vector3d.YAxis);
        Circle baseCirc = new Circle(circlePlane,8);
        Cylinder cyl = new Cylinder(baseCirc,4*height);
        Brep closedCyl = cyl.ToBrep(true,true);

        if(closedLoft.SolidOrientation == BrepSolidOrientation.Inward) closedLoft.Flip();
        if(closedCyl.SolidOrientation == BrepSolidOrientation.Inward) closedCyl.Flip();
        List<Brep> brepCopiesUntrimmed = new List<Brep> { closedLoft.DuplicateBrep() };

        Brep[] subtractedBlade = Brep.CreateBooleanDifference(closedLoft,closedCyl,0.1);

        List<Brep> brepCopies = new List<Brep> { subtractedBlade[0].DuplicateBrep() };

        double angle = 360/Convert.ToDouble(profileCount) * (Math.PI / 180.0); // Convert degrees to radians

        for (int i = 1; i < profileCount; i++) // Create 2 additional rotated Breps
        {
            Transform rotation = Transform.Rotation(angle * i, Vector3d.ZAxis, Point3d.Origin);

            Brep rotatedBrep = subtractedBlade[0].DuplicateBrep();
            rotatedBrep.Transform(rotation);
            brepCopies.Add(rotatedBrep);

            Brep rotatedBrepUntrimmed = brepCopiesUntrimmed[0].DuplicateBrep();
            rotatedBrepUntrimmed.Transform(rotation);
            brepCopiesUntrimmed.Add(rotatedBrepUntrimmed);
        }

        bladesOut = brepCopies;
        untrimmedBladeOut = brepCopiesUntrimmed;

        BoundingBox interfaceBox = interfaceIn.GetBoundingBox(true);
        double radius = (interfaceBox.Max.X - interfaceBox.Min.X) /2;
        Circle baseCircle = new Circle(new Point3d(interfaceBox.Center.X, interfaceBox.Center.Y, interfaceBox.Min.Z), radius);
        Cylinder interfaceCylinder = new Cylinder(baseCircle,interfaceBox.Max.Z-interfaceBox.Min.Z);
        simplifiedInterface = interfaceCylinder.ToBrep(true,true);


    }  
}
# ---------- end c_script_8 ----------

# ---- group: Outer Trim of Blades
move = Move(Geometry=c_script_7.ringCircle, Motion="{0,0,-30}")  # -> Geometry, Transform
offset = OffsetCurve(Curve=move.Geometry, Distance="30", Corners=1)
extr = Extrude(Base=move.Geometry, Direction="{0,0,60}")
extr_2 = Extrude(Base=offset, Direction="{0,0,60}")
cap = CapHoles(Brep=extr)
cap_2 = CapHoles(Brep=extr_2)
sdiff = SolidDifference(BrepsA=cap_2, BrepsB=cap)
sdiff_2 = SolidDifference(BrepsA=c_script_8.bladesOut, BrepsB=sdiff)

# ----
# Outputs
# Separated Meshes
button = Button()
exportsolution = GetBoolean(button, AtLeast=1, AtMost=1, FalseValue="False", TreeAccess=False, TrueValue="True")
curve = Curve(c_script_3.profileOut)
curve_2 = Curve(c_script_2.profileOut)
curve_3 = Curve(c_script_5.profileOut)
c_script_9 = CSharpScript(
    ring=c_script_7.ring,
    blades=c_script_8.bladesOut,
    launcher=launcherinterface,
    tip=tip_text_underline,
    trigger=exportsolution)  # -> out, brepOut; inputs ring: Brep, blades: list of Brep, launcher: Brep, tip: Brep, trigger: Boolean
# ---------- c_script_9: C# ----------
// Grasshopper Script Instance
#region Usings
using System;
using System.Linq;
using System.Collections;
using System.Collections.Generic;
using System.Drawing;

using Rhino;
using Rhino.Geometry;

using Grasshopper;
using Grasshopper.Kernel;
using Grasshopper.Kernel.Data;
using Grasshopper.Kernel.Types;
#endregion

public class Script_Instance : GH_ScriptInstance
{
    #region Notes
    /* 
      Members:
        RhinoDoc RhinoDocument
        GH_Document GrasshopperDocument
        IGH_Component Component
        int Iteration

      Methods (Virtual & overridable):
        Print(string text)
        Print(string format, params object[] args)
        Reflect(object obj)
        Reflect(object obj, string method_name)
    */
    #endregion

    private void RunScript(
		Brep ring,
		List<Brep> blades,
		Brep launcher,
		Brep tip,
		bool trigger,
		ref object brepOut)
    {
        if(trigger)
        {
            List<Brep> joinBreps = new List<Brep>();
            joinBreps.Add(ring);
            joinBreps.AddRange(blades);
            joinBreps.Add(launcher);
            joinBreps.Add(tip);
            Brep[] joinedBreps = Brep.JoinBreps(joinBreps,0.05);
            Brep[] unitedBreps = Brep.CreateBooleanUnion(joinedBreps,0.06);
            brepOut = unitedBreps[0];           
        }
        else
        {
            brepOut = null;
        }
    }
}
# ---------- end c_script_9 ----------
context_bake = ContextBake(MiddleProfile=curve_3)
context_bake_2 = ContextBake(InnerProfile=curve_2)
context_bake_3 = ContextBake(OuterProfile=curve)
smooth = SettingsQuality()
jagged = SettingsSpeed()
brep_5 = Brep(c_script_8.simplifiedInterface)
brep_6 = Brep(c_script_8.untrimmedBladeOut)
mesh = MeshBrep(Brep=c_script_9.brepOut, Settings=smooth)  # -> flatten(Mesh)
mesh_2 = MeshBrep(Brep=brep_6, Settings=jagged)  # -> flatten(Mesh)
mesh_3 = MeshBrep(Brep=c_script_7.ring, Settings=jagged)  # -> flatten(Mesh)
mesh_4 = MeshBrep(Brep=sdiff_2, Settings=jagged)  # -> flatten(Mesh)
mesh_5 = MeshBrep(Brep=launcherinterface, Settings=jagged)  # -> flatten(Mesh)
mesh_6 = MeshBrep(Brep=brep_5, Settings=jagged)  # -> flatten(Mesh)
c_script_10 = CSharpScript(mesh=mesh_2)  # -> base64Draco; inputs mesh: Mesh
# ---------- c_script_10: C# ----------
// Grasshopper Script Instance
#region Usings
using System;
using System.Linq;
using System.Collections;
using System.Collections.Generic;
using System.Drawing;

using Rhino;
using Rhino.Geometry;

using Grasshopper;
using Grasshopper.Kernel;
using Grasshopper.Kernel.Data;
using Grasshopper.Kernel.Types;
#endregion

public class Script_Instance : GH_ScriptInstance
{
    #region Notes
    /* 
      Members:
        RhinoDoc RhinoDocument
        GH_Document GrasshopperDocument
        IGH_Component Component
        int Iteration

      Methods (Virtual & overridable):
        Print(string text)
        Print(string format, params object[] args)
        Reflect(object obj)
        Reflect(object obj, string method_name)
    */
    #endregion

    private void RunScript(Mesh mesh, ref object base64Draco)
    {
        if(mesh != null)
        {
        Rhino.FileIO.DracoCompressionOptions options = new Rhino.FileIO.DracoCompressionOptions();
        options.CompressionLevel = 5;
        options.IncludeTextureCoordinates = false;
        options.IncludeVertexColors = true;

        var compressed = Rhino.FileIO.DracoCompression.Compress(mesh, options);
        base64Draco = compressed.ToBase64String();
        }
    }
}
# ---------- end c_script_10 ----------
c_script_11 = CSharpScript(mesh=mesh_4)  # -> base64Draco; inputs mesh: Mesh; same code as c_script_10
c_script_12 = CSharpScript(mesh=mesh_6)  # -> base64Draco; inputs mesh: Mesh; same code as c_script_10
c_script_13 = CSharpScript(mesh=mesh_3)  # -> base64Draco; inputs mesh: Mesh; same code as c_script_10
c_script_14 = CSharpScript(mesh=mesh_5)  # -> base64Draco; inputs mesh: Mesh; same code as c_script_10
c_script_15 = CSharpScript(mesh=mesh)  # -> base64Draco; inputs mesh: Mesh; same code as c_script_10
context_print = ContextPrint(MeshUntrimmedBlades=c_script_10)
context_print_2 = ContextPrint(MeshProfile=c_script_11)
context_print_3 = ContextPrint(MeshSimpleInterface=c_script_12)
context_print_4 = ContextPrint(MeshRing=c_script_13)
context_print_5 = ContextPrint(MeshLauncher=c_script_14)
context_print_6 = ContextPrint(MeshFinal=c_script_15)
